# Grasshopper definition ExampleFile.gh (Grasshopper 1.0.8)
# plug-ins: Natrix

curve = Curve(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)
curve_2 = Curve([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])

curve_3 = Curve(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)
curve_4 = Curve(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)

curve_5 = Curve(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)
curve_6 = Curve([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])

crv = Curve(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)
curve_7 = Curve(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)

curve_8 = Curve(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)
curve_9 = Curve([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])

curve_10 = Curve(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)
curve_11 = Curve([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])

curve_12 = Curve(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)
curve_13 = Curve([<curve referenced from the Rhino model> x2])  # disabled

crv_2 = Curve(reparameterize(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))
crv_3 = Curve(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)
crv_4 = Curve(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)
crv_5 = Curve(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)
crv_6 = Curve(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)
crv_7 = Curve(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)
crv_8 = Curve(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)
crv_9 = Curve(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)
start_generation_fast = StartGenerationFast(
    Outline=crv_2,
    ExcludeBoundaries=curve_11,
    AddRamp=False,
    CellSizeMeters=5.5,
    EntranceSide=0,
    FastCellSizeMeters=5.5,
    FastDurationSeconds=0,
    GenerationInterval=1000,
    WasRunning=False)
sortresults = SortResults(ResetGeneration=Toggle(False), Parking=start_generation_fast)  # -> Parking, GenerationCollection
deconstruct_parking_collection = DeconstructParkingCollection(GenerationCollection=sortresults.GenerationCollection)  # -> Ids, Scores
list_item = ListItem(List=deconstruct_parking_collection.Ids, Index=Slider(2, range=0..30), Wrap=True)
selectparking = SelectParking(Generations=sortresults.GenerationCollection, ParkingId=list_item)
boolean_toggle = BooleanToggle(True)
export_top_parking_options = ExportTopParkingOptions(GenerationCollection=sortresults.GenerationCollection, TopCount="9", PNGWidth=2000)  # -> SelectedOptions, Scores
preview_parking_result = PreviewParkingResult(
    Parking=selectparking,
    BakeCars=boolean_toggle,
    BakeGradientCells=boolean_toggle,
    BakePath=boolean_toggle,
    BakeExcludedCells=boolean_toggle,
    BakeEntranceCell=boolean_toggle,
    BakeWalls=boolean_toggle)
bake_parking_result = BakeParkingResult(Parking=selectparking)
